# Grasshopper definition Direct_Sunlight_Analysis.gh (Grasshopper 1.0.8)

# Center Point for Sun Path Dome
# location of the dome does not matter, purely for aesthetic purposes
center_point_for_sun_path_dome = Point(Point(-28.02500554, 134.0270183, -0.15))
# North Direction in Degrees
# When set to 0, uses model North
# Preset Dates:
# - March Equinox
# 
# - June Solstice
#     **Summer Solstice in Northern Hemisphere, Winter Solstice in Southern Hemisphere
# 
# - September Equinox
# 
# - December Solstice
#     **Winter Solstice in Northern Hemisphere, Summer Solstice in Southern Hemisphere
north = Slider(0, range=-180..180)
# Objects to Analyze Solar
# input: polysurface or surface
buildings_to_analyze_shadow = Geometry([<brep referenced from the Rhino model> x31, <extrusion referenced from the Rhino model>, <brep referenced from the Rhino model> x4])
# Objects That Cast Shade
# input: polysurface or surface
# [optional] Vegetation / Trees That Cast Shade
objects_that_cast_shade = Geometry([<brep referenced from the Rhino model> x5])
# Resolution (Lower number is higher resolution)
resolution = Slider(1, range=0..60)
# Scale for Sun Path Dome
# scale of the dome does not matter, purely for aesthetic purposes
sun_path_dome_scale = Slider(2.1, range=0.1..10)
# Import Location from EPW File
# https://www.ladybug.tools/epwmap/
epw = Panel("https://climate.onebuilding.org/WMO_Region_2_Asia/SAU_Saudi_Arabia/TB_Tabuk/SAU_TB_Tabuk.Rgnl.AP.403750_TMYx.zip")
# input: block instance
# grasshopper makes component orange when no input is given, but it's okay
vegetation_trees_that_cast_shade = Geometry()
value_list = ValueList({"Will Use Custom Date": "", "March Equinox", "June Solstice", "September Equinox", "December Solstice"}, selected="June Solstice")
# Custom Date:
start_month = ValueList({"January": 1, "February": 2, "March": 3, "April": 4, "May": 5, "June": 6, "July": 7, "August": 8, "September": 9, "October": 10, "November": 11, "December": 12}, selected="January")
# To use custom date, select
# "Will Use Custom Date"
# for the Preset Dates above
start_day = ValueList({"1", "2", "3", "4", "5", "6", "7", "8", "9", "10"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}, selected="1")
start_hour = ValueList({"0", "1", "2", "3", "4", "5", "6", "7", "8", "9", "10", "11", "12", "13", "14", "15", "16", "17", "18", "19", "20", "21", "22", "23"}, selected="0")
end_month = ValueList({"January": 1, "February": 2, "March": 3, "April": 4, "May": 5, "June": 6, "July": 7, "August": 8, "September": 9, "October": 10, "November": 11, "December": 12}, selected="January")
end_day = ValueList({"1", "2", "3", "4", "5", "6", "7", "8", "9", "10"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}, selected="1")
end_hour = ValueList({"0", "1", "2", "3", "4", "5", "6", "7", "8", "9", "10", "11", "12", "13", "14", "15", "16", "17", "18", "19", "20", "21", "22", "23"}, selected="0")
direct_sunlight_analysis = DirectSunlightAnalysis(
    relay=epw,
    north=north,
    relay_2=value_list,
    relay_3=start_month,
    relay_4=start_day,
    relay_5=start_hour,
    relay_6=end_month,
    relay_7=end_day,
    relay_8=end_hour,
    relay_9=buildings_to_analyze_shadow,
    relay_10=objects_that_cast_shade,
    relay_11=vegetation_trees_that_cast_shade,
    relay_12=resolution,
    relay_13=center_point_for_sun_path_dome,
    relay_14=sun_path_dome_scale)  # -> mesh_2, legend, result
sun_path_dome = Geometry(direct_sunlight_analysis.result)
mesh = Geometry(direct_sunlight_analysis.mesh_2)
legend = Geometry(direct_sunlight_analysis.legend)

# ==== cluster DirectSunlightAnalysis
relay = ClusterInput()
relay_2 = ClusterInput()
relay_3 = ClusterInput()
relay_4 = ClusterInput()
relay_5 = ClusterInput()
relay_6 = ClusterInput()
relay_7 = ClusterInput()
relay_8 = ClusterInput()
relay_9 = ClusterInput()
relay_10 = ClusterInput()
relay_11 = ClusterInput()
relay_12 = ClusterInput()
relay_13 = ClusterInput()
relay_14 = ClusterInput()
downloadepw = LBDownloadWeather(weather_URL=relay)  # -> epw_file, stat_file, ddy_file; plug-in component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
model_block_instance = ModelBlockInstance(BlockInstance=relay_11)  # -> BlockInstance, Transform, BlockDefinition
python_3_script = Python3Script(
    preset_date=relay_2,
    in_start_month=relay_3,
    in_start_day=relay_4,
    in_start_hour=relay_5,
    in_end_month=relay_6,
    in_end_day=relay_7,
    in_end_hour=relay_8)  # -> start_month, start_day, start_hour, end_month, end_day, end_hour
# ---------- python_3_script: Python ----------
if preset_date == "March Equinox":
    start_month, start_day, start_hour = 3, 21, 0
    end_month, end_day, end_hour = 3, 21, 23
elif preset_date == "June Solstice":
    start_month, start_day, start_hour = 6, 21, 0
    end_month, end_day, end_hour = 6, 21, 23
elif preset_date == "September Equinox":
    start_month, start_day, start_hour = 9, 21, 0
    end_month, end_day, end_hour = 9, 21, 23
elif preset_date == "December Solstice":
    start_month, start_day, start_hour = 12, 21, 0
    end_month, end_day, end_hour = 12, 21, 23
else:
    start_month, start_day, start_hour = 12, 21, 0
    end_month, end_day, end_hour = 12, 21, 23
# ---------- end python_3_script ----------
importloc = LBImportLocation(epw_file=downloadepw.epw_file)  # -> location; plug-in component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
explode_object = ExplodeObject(Object=model_block_instance.BlockInstance, Recursive=False)
analysisperiod = LBAnalysisPeriod(
    start_month=python_3_script.start_month,
    start_day=python_3_script.start_day,
    start_hour=python_3_script.start_hour,
    end_month=python_3_script.end_month,
    end_day=python_3_script.end_day,
    end_hour=python_3_script.end_hour)  # -> period, hoys, dates; plug-in component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
mesh = Mesh(explode_object)
merge = Merge(Data1=relay_10, Data2=mesh)
clean_tree = CleanTree(RemoveNulls=True, RemoveInvalid=True, RemoveEmpty=False, Tree=merge)  # -> simplify(flatten(Tree))
north = ClusterInput()
sunpath = LBSunPath(north=north, location=importloc, hoys=analysisperiod.hoys, center_pt=relay_13, scale=relay_14)  # -> out, vectors, altitudes, azimuths, hoys, sun_pts, analemma, daily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; plug-in component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
python_3_script_2 = Python3Script()  # -> ten_centimeters_in_model_unit
# ---------- python_3_script_2: Python ----------
import Rhino

doc = Rhino.RhinoDoc.ActiveDoc

if doc:
    # Get the model unit system
    unit_system = doc.ModelUnitSystem
    # Convert to string for display
    model_unit = unit_system.ToString()
else:
    model_unit = "No active document"

if model_unit == "Millimeters":
    ten_centimeters_in_model_unit = 100
elif model_unit == "Centimeters":
    ten_centimeters_in_model_unit = 10
elif model_unit == "Meters":
    ten_centimeters_in_model_unit = 0.1
else:
    ten_centimeters_in_model_unit = 10
# ---------- end python_3_script_2 ----------
directsunhours = LBDirectSunHours(
    vectors=flatten(sunpath.vectors),
    geometry=flatten(relay_9),
    context=flatten(clean_tree),
    grid_size=relay_12,
    offset_dist=python_3_script_2,
    run=True)  # -> out, points, results, mesh, legend, title, int_mtx; plug-in component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
merge_2 = Merge(Data1=sunpath.sun_pts, Data2=sunpath.analemma, Data3=sunpath.daily, Data4=sunpath.compass)
result = ClusterOutput(merge_2)
mesh_2 = ClusterOutput(directsunhours.mesh)
legend = ClusterOutput(directsunhours.legend)
